# Grasshopper definition hyparnew.gh (Grasshopper 1.0.8)

number_slider = Slider(12, range=0..100)
number_slider_2 = Slider(12, range=0..100)
number_slider_3 = Slider(12, range=0..100)
length = Slider(20, range=0..100)
neg = Negative(Value=number_slider_2)
origin_pt = ConstructPoint(XCoordinate=0, YCoordinate=0, ZCoordinate=0)
wing_pt_1 = ConstructPoint(XCoordinate=number_slider, YCoordinate=number_slider_2, ZCoordinate=number_slider_3)
wing_pt_2 = ConstructPoint(XCoordinate=number_slider, YCoordinate=neg, ZCoordinate=number_slider_3)
opp_pt = ConstructPoint(XCoordinate=length, YCoordinate=0, ZCoordinate=0)
ln = Line(StartPoint=wing_pt_2, EndPoint=opp_pt)
ln_2 = Line(StartPoint=origin_pt, EndPoint=wing_pt_1)
divide = DivideCurve(Curve=ln, Count=10, Kinks=False)  # -> Points, Tangents, Parameters
divide_2 = DivideCurve(Curve=ln_2, Count=10, Kinks=False)  # -> Points, Tangents, Parameters
panel_number_each_axis = Slider(5, range=0..10)
ln_3 = Line(StartPoint=divide_2.Points, EndPoint=divide.Points)
loft = Loft(Curves=ln_3, Options={Adjust=False, Closed=False, LoftEnds=0, LoftSimp=0, LoftType=0, Rebuild=10, Refit=0.01})
divide_3 = DivideDomain²(Domain=loft, UCount=panel_number_each_axis, VCount=panel_number_each_axis)
length_2 = Slider(20, range=0..100)
i = Index(0)
subsrf = Isotrim(Surface=loft, Domain=divide_3)
lng = ListLength(List=subsrf)  # -> expr("x-1", Length)
xy = XYPlane(Origin=Point(0, 0, 0))
cull_i = CullIndex(List=subsrf, Indices=flatten([i, lng]), Wrap=True)
dist = Distance(PointA=xy, PointB=divide_2.Points)
item = ListItem(List=subsrf, Index=[i, lng], Wrap=True)
division = Division(A=dist, B=length_2)
area = Area(Geometry=cull_i)  # -> Area, Centroid
circle_radii = CircleCNR(Center=area.Centroid, Normal=Vector(0, 0, 1), Radius=division)  # -> graft(Circle)
item_2 = ListItem(List=flatten(item), Index=0, Wrap=True)
project = Project(Curve=circle_radii, Brep=subsrf, Direction=Vector(0, 0, 1))
panel_thickness = Slider(0.448, range=0..1)
debrep = DeconstructBrep(Brep=item)  # -> Faces, Edges, Vertices
srfsplit = SurfaceSplit(Surface=flatten(cull_i), Curves=flatten(project))
movetoplane = MoveToPlane(Geometry=debrep.Vertices, Plane=PlaneXY(0, 0, 0), Above=True, Below=True)  # -> Geometry, Transform
item_3 = ListItem(List=debrep.Vertices, Index=0, Wrap=True)  # -> Item, Item1, Item2, Item3
surface_circles = CullPattern(List=srfsplit, CullPattern=[False, True])
item_4 = ListItem(List=movetoplane.Geometry, Index=0, Wrap=True)  # -> Item, Item1, Item2, Item3
neg_2 = Negative(Value=panel_thickness)
surface_holed = CullPattern(List=srfsplit, CullPattern=[True, False])
area_2 = Area(Geometry=item)  # -> Area, Centroid
tbox = TwistedBox(
    CornerA=item_3.Item,
    CornerB=item_3.Item1,
    CornerC=item_3.Item2,
    CornerD=item_3.Item3,
    CornerE=item_4.Item,
    CornerF=item_4.Item1,
    CornerG=item_4.Item2,
    CornerH=item_4.Item3)
offset = OffsetSurface(Surface=item, Distance=neg_2, Retrim=True)
offset_2 = OffsetSurface(Surface=surface_holed, Distance=neg_2, Retrim=True)
area_3 = Area(Geometry=offset)  # -> Area, Centroid
area_4 = Area(Geometry=surface_holed)  # -> Area, Centroid
area_5 = Area(Geometry=offset_2)  # -> Area, Centroid
ln_4 = Line(StartPoint=area_2.Centroid, EndPoint=area_3.Centroid)
ln_5 = Line(StartPoint=area_4.Centroid, EndPoint=area_5.Centroid)
extr = Extrude(Base=item, Direction=ln_4)
extr_2 = Extrude(Base=surface_holed, Direction=ln_5)
